test file "test"

suite "iter_suite"

  case "iter_case" [simulation]
    model model
    iteration script:
      loadgrid("envelope.mat").applyTo(sltest_testCase);

  case "iter_case1" [simulation]
    model model
    iteration script:
      loadgrid("envelope.mat").applyTo(sltest_testCase, "FilterDisabled", true);